# Dynamo graph DataExtraction_IFC_Sumit.dyn (Dynamo 3.5.0.8297)

categories = Categories("OST_GenericModel")
all_elements_of_category = ElementsOfCategory(Category=categories)
python_script = Python(IN[0]=all_elements_of_category)  # CPython3
# ---------- python_script.python (162 lines) ----------
import clr, math
clr.AddReference("RevitAPI"); from Autodesk.Revit.DB import *
clr.AddReference("RevitServices"); from RevitServices.Persistence import DocumentManager
doc = DocumentManager.Instance.CurrentDBDocument

clr.AddReference("ProtoGeometry"); from Autodesk.DesignScript.Geometry import Point as DSPt

# optional: Dynamo-Wrapper
try:
    clr.AddReference("RevitNodes"); import Revit
except: pass

# --------- helpers ----------
def flatten(x):
    if isinstance(x, list):
        r=[]; [r.extend(flatten(i)) for i in x]; return r
    return [x]

def to_db(el):
    # Dynamo-Wrapper → DB.Element
    try:
        ie = el.InternalElement
        if isinstance(ie, Element): return ie
    except: pass
    try:
        ue = UnwrapElement(el)
        if isinstance(ue, Element): return ue
    except: pass
    if isinstance(el, Element): return el
    return None

def pt(xyz): return DSPt.ByCoordinates(xyz.X, xyz.Y, xyz.Z)
def pt_from_bb(bb):
    return DSPt.ByCoordinates((bb.Min.X+bb.Max.X)/2.0,(bb.Min.Y+bb.Max.Y)/2.0,(bb.Min.Z+bb.Max.Z)/2.0)

def midpoint(e):
    # bevorzugt: FamilyInstance.Transform.Origin
    if isinstance(e, FamilyInstance):
        try:
            tr = e.GetTransform()
            if tr: 
                o = tr.Origin
                if abs(o.X)+abs(o.Y)+abs(o.Z) > 1e-7: return pt(o)
        except: pass
    # Location
    loc = e.Location
    if isinstance(loc, LocationPoint):
        p = loc.Point
        if abs(p.X)+abs(p.Y)+abs(p.Z) > 1e-7: return pt(p)
    elif isinstance(loc, LocationCurve):
        mp = loc.Curve.Evaluate(0.5, True); return pt(mp)
    # BoundingBox global
    try:
        bb = e.get_BoundingBox(None)
        if bb: return pt_from_bb(bb)
    except: pass
    # Solids-Centroid (ohne View)
    opts = Options(); opts.DetailLevel = ViewDetailLevel.Fine; opts.IncludeNonVisibleObjects = True
    ge = e.get_Geometry(opts)
    solids=[]
    if ge:
        for g in ge:
            if isinstance(g, Solid) and g.Volume > 1e-9: solids.append(g)
            elif isinstance(g, GeometryInstance):
                for gi in g.GetInstanceGeometry():
                    if isinstance(gi, Solid) and gi.Volume > 1e-9: solids.append(gi)
    if solids:
        V=cx=cy=cz=0.0
        for s in solids:
            try: c = s.ComputeCentroid()
            except:
                bb = s.GetBoundingBox(); 
                c = XYZ((bb.Min.X+bb.Max.X)/2.0,(bb.Min.Y+bb.Max.Y)/2.0,(bb.Min.Z+bb.Max.Z)/2.0)
            v = max(s.Volume,0.0); 
            if v>0: V+=v; cx+=c.X*v; cy+=c.Y*v; cz+=c.Z*v
        if V>0: 
            from Autodesk.DesignScript.Geometry import Point as DSPt
            return DSPt.ByCoordinates(cx/V, cy/V, cz/V)
    return DSPt.ByCoordinates(0,0,0)

def euler_zyx_from_matrix(bx, by, bz):
    """
    Revit Transform liefert Spaltenvektoren (BasisX/Y/Z) in Weltkoordinaten.
    Zerlegung R = Rz(yaw)*Ry(pitch)*Rx(roll) (Z-Y-X).
    """
    r11, r21, r31 = bx.X, bx.Y, bx.Z
    r12, r22, r32 = by.X, by.Y, by.Z
    r13, r23, r33 = bz.X, bz.Y, bz.Z

    # numerische Stabilität
    r31 = max(min(r31, 1.0), -1.0)
    # Pitch
    pitch = math.asin(-r31)
    cp = math.cos(pitch)
    if abs(cp) > 1e-8:
        roll  = math.atan2(r32, r33)
        yaw   = math.atan2(r21, r11)
    else:
        # Gimbal lock: cp≈0 => r31≈±1
        roll  = 0.0
        yaw   = math.atan2(-r12, r22)

    # in Grad 0..360 normieren
    def deg(a): 
        d = math.degrees(a)
        d = d % 360.0
        if d < 0: d += 360.0
        return d
    return (deg(yaw), deg(pitch), deg(roll))

def rotation_ypr(e):
    # 1) FamilyInstance: vollständige Transform
    if isinstance(e, FamilyInstance):
        try:
            tr = e.GetTransform()
            if tr:
                return euler_zyx_from_matrix(tr.BasisX, tr.BasisY, tr.BasisZ)
        except: pass
    # 2) Kurvenbasiert: Richtungsvektor → Yaw/Pitch, Roll=0
    loc = e.Location
    if isinstance(loc, LocationCurve):
        dv = loc.Curve.ComputeDerivatives(0.5, True).BasisX
        # Richtung normalisieren
        mag = math.sqrt(dv.X*dv.X + dv.Y*dv.Y + dv.Z*dv.Z)
        if mag > 1e-9:
            dx, dy, dz = dv.X/mag, dv.Y/mag, dv.Z/mag
            yaw   = math.degrees(math.atan2(dy, dx)) % 360.0
            pitch = math.degrees(math.atan2(-dz, math.sqrt(dx*dx + dy*dy))) % 360.0
            roll  = 0.0
            return (yaw, pitch, roll)
    # 3) Wände/ähnliche: Orientierung in XY → nur Yaw
    if isinstance(e, Wall):
        v = e.Orientation
        yaw = math.degrees(math.atan2(v.Y, v.X)) % 360.0
        return (yaw, 0.0, 0.0)
    # 4) Kein besserer Anhalt → 0/0/0
    return (0.0, 0.0, 0.0)

def ifc_guid(e):
    try:
        from Autodesk.Revit.DB import ExporterIFCUtils
        g = ExporterIFCUtils.CreateGUID(e.Id)
        if g: return g
    except: pass
    for pname in ("IFC GUID","IfcGUID","IFCGUID","IFCGlobalId"):
        p = e.LookupParameter(pname)
        if p and p.StorageType == StorageType.String:
            v = p.AsString()
            if v: return v
    try: return e.UniqueId
    except: return str(e.Id.IntegerValue)

# --------- run ----------
raw = flatten(IN[0])
db = [to_db(x) for x in raw if x is not None and not isinstance(x, ElementType)]
guids  = [ifc_guid(e) for e in db]
points = [midpoint(e) for e in db]
ypr    = [rotation_ypr(e) for e in db]
yaw_deg   = [t[0] for t in ypr]
pitch_deg = [t[1] for t in ypr]
roll_deg  = [t[2] for t in ypr]
OUT = [guids, points, yaw_deg, pitch_deg, roll_deg]
# ----------------------------------------
categories_2 = Categories("OST_SpecialityEquipment")
all_elements_of_category_2 = ElementsOfCategory(Category=categories_2)
python_script_2 = Python(IN[0]=all_elements_of_category_2)  # CPython3
# ---------- python_script_2.python (260 lines) ----------
# IN[0]: Liste (ggf. verschachtelt) von Revit-Element-Instanzen
import clr, math, sys
clr.AddReference("RevitAPI"); from Autodesk.Revit.DB import *
clr.AddReference("RevitServices"); from RevitServices.Persistence import DocumentManager
doc = DocumentManager.Instance.CurrentDBDocument

clr.AddReference("ProtoGeometry"); from Autodesk.DesignScript.Geometry import Point as DSPt

# optional: Dynamo-Wrapper
try:
    clr.AddReference("RevitNodes"); import Revit
except:
    pass

# -------- helpers ----------
def flatten(x):
    if isinstance(x, list):
        out = []
        for i in x:
            out.extend(flatten(i))
        return out
    return [x]

def to_db(el):
    # Dynamo Wrapper -> DB.Element
    try:
        ie = el.InternalElement
        if isinstance(ie, Element): return ie
    except: pass
    try:
        ue = UnwrapElement(el)
        if isinstance(ue, Element): return ue
    except: pass
    if isinstance(el, Element): return el
    return None

def pt_xyz(xyz):
    return DSPt.ByCoordinates(xyz.X, xyz.Y, xyz.Z)

def midpoint(e):
    # 1) FamilyInstance.Transform.Origin
    if isinstance(e, FamilyInstance):
        try:
            tr = e.GetTransform()
            if tr:
                o = tr.Origin
                if abs(o.X)+abs(o.Y)+abs(o.Z) > 1e-8:
                    return pt_xyz(o)
        except: pass
    # 2) Location
    try:
        loc = e.Location
        if isinstance(loc, LocationPoint):
            p = loc.Point
            if abs(p.X)+abs(p.Y)+abs(p.Z) > 1e-8:
                return pt_xyz(p)
        elif isinstance(loc, LocationCurve):
            mp = loc.Curve.Evaluate(0.5, True)
            return pt_xyz(mp)
    except: pass
    # 3) BoundingBox (global)
    try:
        bb = e.get_BoundingBox(None)
        if bb:
            return DSPt.ByCoordinates((bb.Min.X+bb.Max.X)/2.0,
                                      (bb.Min.Y+bb.Max.Y)/2.0,
                                      (bb.Min.Z+bb.Max.Z)/2.0)
    except: pass
    # 4) Solids-Centroid (view-unabhängig)
    try:
        opts = Options(); opts.DetailLevel = ViewDetailLevel.Fine; opts.IncludeNonVisibleObjects = True
        ge = e.get_Geometry(opts)
        solids=[]
        if ge:
            for g in ge:
                if isinstance(g, Solid) and g.Volume > 1e-9: solids.append(g)
                elif isinstance(g, GeometryInstance):
                    for gi in g.GetInstanceGeometry():
                        if isinstance(gi, Solid) and gi.Volume > 1e-9: solids.append(gi)
        if solids:
            V=cx=cy=cz=0.0
            for s in solids:
                try:
                    c = s.ComputeCentroid()
                except:
                    bb = s.GetBoundingBox()
                    if not bb: continue
                    c = XYZ((bb.Min.X+bb.Max.X)/2.0,(bb.Min.Y+bb.Max.Y)/2.0,(bb.Min.Z+bb.Max.Z)/2.0)
                v = max(s.Volume,0.0)
                if v<=0: continue
                V+=v; cx+=c.X*v; cy+=c.Y*v; cz+=c.Z*v
            if V>0:
                return DSPt.ByCoordinates(cx/V, cy/V, cz/V)
    except: pass
    return DSPt.ByCoordinates(0,0,0)

def ang_deg(a):
    d = math.degrees(a) % 360.0
    if d < 0: d += 360.0
    return d

def rotation_ypr_with_source(e):
    """Yaw (Z), Pitch (Y), Roll (X) in Grad + source string"""
    yaw = pitch = roll = 0.0
    src = []

    tr = None
    try:
        if isinstance(e, FamilyInstance):
            tr = e.GetTransform()
    except:
        tr = None

    # Yaw-Kandidaten
    yaw_candidates = []
    # LP.Rotation (um Z, Radiant)
    try:
        loc = e.Location
        if isinstance(loc, LocationPoint):
            yaw_lp = ang_deg(loc.Rotation)
            yaw_candidates.append(("LP.Rotation", yaw_lp))
    except:
        pass
    # Facing/Hand
    try:
        if isinstance(e, FamilyInstance):
            fv = e.FacingOrientation
            yaw_fv = ang_deg(math.atan2(fv.Y, fv.X))
            yaw_candidates.append(("FI.Facing", yaw_fv))
    except:
        pass
    try:
        if isinstance(e, FamilyInstance):
            hv = e.HandOrientation
            yaw_hv = ang_deg(math.atan2(hv.Y, hv.X))
            yaw_candidates.append(("FI.Hand", yaw_hv))
    except:
        pass
    # Transform
    try:
        if tr:
            yaw_tr = ang_deg(math.atan2(tr.BasisX.Y, tr.BasisX.X))
            yaw_candidates.append(("FI.Transform", yaw_tr))
    except:
        pass
    # Kurvenrichtung
    try:
        loc2 = e.Location
        if isinstance(loc2, LocationCurve):
            dv = loc2.Curve.ComputeDerivatives(0.5, True).BasisX
            yaw_cv = ang_deg(math.atan2(dv.Y, dv.X))
            yaw_candidates.append(("Curve.Tangent", yaw_cv))
    except:
        pass

    if yaw_candidates:
        order = {"LP.Rotation":0, "FI.Facing":1, "FI.Hand":2, "FI.Transform":3, "Curve.Tangent":4}
        yaw_candidates.sort(key=lambda t: order.get(t[0], 99))
        yaw = yaw_candidates[0][1]
        src.append(yaw_candidates[0][0])
    else:
        src.append("Yaw:0")

    # Pitch: aus BasisZ (Transform) oder Kurventangente
    try:
        if tr:
            bz = tr.BasisZ
            bzZ = max(min(bz.Z, 1.0), -1.0)
            # Neigung gg. Welt-Z
            pitch = ang_deg(math.acos(bzZ))
            src.append("Pitch:Tr.BasisZ")
        else:
            if isinstance(e.Location, LocationCurve):
                dv = e.Location.Curve.ComputeDerivatives(0.5, True).BasisX
                horiz = math.sqrt(dv.X*dv.X + dv.Y*dv.Y)
                pitch = ang_deg(math.atan2(-dv.Z, horiz))
                src.append("Pitch:Tangent")
    except:
        src.append("Pitch:0")

    # Roll: aus BasisX relativ zu BasisZ
    try:
        if tr:
            bx = tr.BasisX; bz = tr.BasisZ
            dot = bx.X*bz.X + bx.Y*bz.Y + bx.Z*bz.Z
            projX = XYZ(bx.X - dot*bz.X, bx.Y - dot*bz.Y, bx.Z - dot*bz.Z)
            m = math.sqrt(projX.X**2 + projX.Y**2 + projX.Z**2)
            if m > 1e-9:
                ux = XYZ(projX.X/m, projX.Y/m, projX.Z/m)
                # Referenz: Welt-X auf Ebene ⟂ bz projiziert
                dotWX = bz.X
                ref = XYZ(1.0 - dotWX*bz.X, 0.0 - dotWX*bz.Y, 0.0 - dotWX*bz.Z)
                mr = math.sqrt(ref.X**2 + ref.Y**2 + ref.Z**2)
                if mr > 1e-9:
                    ur = XYZ(ref.X/mr, ref.Y/mr, ref.Z/mr)
                    dotu = max(min(ux.X*ur.X + ux.Y*ur.Y + ux.Z*ur.Z, 1.0), -1.0)
                    ang = math.acos(dotu)
                    cross = XYZ(ur.Y*ux.Z - ur.Z*ux.Y, ur.Z*ux.X - ur.X*ux.Z, ur.X*ux.Y - ur.Y*ux.X)
                    sgn = cross.X*bz.X + cross.Y*bz.Y + cross.Z*bz.Z
                    if sgn < 0: ang = -ang
                    roll = ang_deg(ang)
                    src.append("Roll:Tr.Bases")
                else:
                    src.append("Roll:0ref")
            else:
                src.append("Roll:0proj")
        else:
            src.append("Roll:0")
    except:
        src.append("Roll:0ex")

    return yaw, pitch, roll, "+".join(src)

def ifc_guid(e):
    # IFC GUID oder Fallback UniqueId
    try:
        from Autodesk.Revit.DB import ExporterIFCUtils
        g = ExporterIFCUtils.CreateGUID(e.Id)
        if g: return g
    except: pass
    for pname in ("IFC GUID","IfcGUID","IFCGUID","IFCGlobalId"):
        try:
            p = e.LookupParameter(pname)
            if p and p.StorageType == StorageType.String:
                v = p.AsString()
                if v: return v
        except: pass
    try:
        return e.UniqueId
    except:
        try:
            return str(e.Id.IntegerValue)
        except:
            return "UNKNOWN"

# -------- run ----------
raw = flatten(IN[0])
db_elems = [to_db(x) for x in raw if x is not None and not isinstance(x, ElementType)]

guids  = []
points = []
yaws   = []
pitchs = []
rolls  = []
sources= []

for e in db_elems:
    try:
        guids.append(ifc_guid(e))
        points.append(midpoint(e))
        y, p, r, s = rotation_ypr_with_source(e)
        yaws.append(y); pitchs.append(p); rolls.append(r); sources.append(s)
    except Exception as ex:
        # Element-spezifischer Fehler → nicht alles auf null reißen
        guids.append("ERR")
        points.append(None)
        yaws.append(0.0); pitchs.append(0.0); rolls.append(0.0)
        sources.append("ERROR:"+str(ex))

OUT = [guids, points, yaws, pitchs, rolls, sources]
# ----------------------------------------
categories_3 = Categories("OST_PipeFitting")
all_elements_of_category_3 = ElementsOfCategory(Category=categories_3)
python_script_3 = Python(IN[0]=all_elements_of_category_3)  # CPython3; same code as python_script_2
categories_4 = Categories("OST_PipeCurves")
all_elements_of_category_4 = ElementsOfCategory(Category=categories_4)
python_script_4 = Python(IN[0]=all_elements_of_category_4)  # CPython3
# ---------- python_script_4.python (187 lines) ----------
# IN[0]: Liste (ggf. verschachtelt) von Revit-Element-Instanzen (keine IDs/Types)
import clr, math
clr.AddReference("RevitAPI"); from Autodesk.Revit.DB import *
clr.AddReference("RevitServices"); from RevitServices.Persistence import DocumentManager
doc = DocumentManager.Instance.CurrentDBDocument
clr.AddReference("ProtoGeometry"); from Autodesk.DesignScript.Geometry import Point as DSPt

# Optional: Dynamo-Wrapper laden
try:
    clr.AddReference("RevitNodes"); import Revit
except:
    pass

# ---------- Utilities ----------
def flatten(x):
    if isinstance(x, list):
        r=[]; [r.extend(flatten(i)) for i in x]; return r
    return [x]

def to_db(el):
    # Dynamo-Wrapper -> DB.Element
    try:
        ie = el.InternalElement
        if isinstance(ie, Element): return ie
    except: pass
    try:
        ue = UnwrapElement(el)
        if isinstance(ue, Element): return ue
    except: pass
    return el if isinstance(el, Element) else None

def dpt_xyz(xyz): return DSPt.ByCoordinates(xyz.X, xyz.Y, xyz.Z)

def midpoint(e):
    # 1) FamilyInstance: Transform-Origin (zuverlässig, Welt-KOS)
    if isinstance(e, FamilyInstance):
        try:
            tr = e.GetTransform()
            if tr:
                o = tr.Origin
                if abs(o.X)+abs(o.Y)+abs(o.Z) > 1e-8:
                    return dpt_xyz(o)
        except: pass
    # 2) Location
    try:
        loc = e.Location
        if isinstance(loc, LocationPoint):
            p = loc.Point
            if abs(p.X)+abs(p.Y)+abs(p.Z) > 1e-8:
                return dpt_xyz(p)
        elif isinstance(loc, LocationCurve):
            mp = loc.Curve.Evaluate(0.5, True)
            return dpt_xyz(mp)
    except: pass
    # 3) BoundingBox (global)
    try:
        bb = e.get_BoundingBox(None)
        if bb:
            return DSPt.ByCoordinates((bb.Min.X+bb.Max.X)/2.0,
                                      (bb.Min.Y+bb.Max.Y)/2.0,
                                      (bb.Min.Z+bb.Max.Z)/2.0)
    except: pass
    # 4) Solids-Centroid (view-unabhängig)
    try:
        opts = Options(); opts.DetailLevel = ViewDetailLevel.Fine; opts.IncludeNonVisibleObjects = True
        ge = e.get_Geometry(opts)
        solids=[]
        if ge:
            for g in ge:
                if isinstance(g, Solid) and g.Volume > 1e-9: solids.append(g)
                elif isinstance(g, GeometryInstance):
                    for gi in g.GetInstanceGeometry():
                        if isinstance(gi, Solid) and gi.Volume > 1e-9: solids.append(gi)
        if solids:
            V=cx=cy=cz=0.0
            for s in solids:
                try:
                    c = s.ComputeCentroid()
                except:
                    bb = s.GetBoundingBox()
                    if not bb: continue
                    c = XYZ((bb.Min.X+bb.Max.X)/2.0,(bb.Min.Y+bb.Max.Y)/2.0,(bb.Min.Z+bb.Max.Z)/2.0)
                v = max(s.Volume,0.0)
                if v<=0: continue
                V+=v; cx+=c.X*v; cy+=c.Y*v; cz+=c.Z*v
            if V>0:
                return DSPt.ByCoordinates(cx/V, cy/V, cz/V)
    except: pass
    return DSPt.ByCoordinates(0,0,0)

def _norm(v):
    m = math.sqrt(v.X*v.X + v.Y*v.Y + v.Z*v.Z)
    if m < 1e-12: return None
    return XYZ(v.X/m, v.Y/m, v.Z/m)

def _euler_zyx_from_bases(bx, by, bz):
    # R = [bx by bz] (Basen in Welt), Euler Z-Y-X → (YawZ, PitchY, RollX) in Grad
    r11, r21, r31 = bx.X, bx.Y, bx.Z
    r12, r22, r32 = by.X, by.Y, by.Z
    r13, r23, r33 = bz.X, bz.Y, bz.Z
    r31 = max(min(r31, 1.0), -1.0)
    pitch = math.asin(-r31)
    cp = math.cos(pitch)
    if abs(cp) > 1e-10:
        roll  = math.atan2(r32, r33)
        yaw   = math.atan2(r21, r11)
    else:
        roll  = 0.0
        yaw   = math.atan2(-r12, r22)
    def deg(a):
        d = math.degrees(a) % 360.0
        if d < 0: d += 360.0
        return d
    return deg(yaw), deg(pitch), deg(roll)

def rotation_ypr_with_source(e):
    """
    Rotation relativ zum Welt-KOS:
    1) Wenn Transform vorhanden: Basen → Euler Z-Y-X (Yaw/Pitch/Roll)
    2) Sonst bei LocationCurve: Tangente + stabile Up-Achse → Basen → Euler
    3) Sonst 0/0/0
    """
    # 1) Transform (z. B. FamilyInstance, einige Systeminstanzen)
    try:
        # FamilyInstance sicher, aber manche andere Elemente haben auch GetTransform()
        tr = e.GetTransform() if hasattr(e, "GetTransform") else None
        if tr:
            bx = _norm(tr.BasisX); by = _norm(tr.BasisY); bz = _norm(tr.BasisZ)
            if bx and by and bz:
                y,p,r = _euler_zyx_from_bases(bx, by, bz)
                return y,p,r,"Transform"
    except:
        pass

    # 2) Kurvenbasierte Elemente (Rohre/Kanäle/Dämmung etc.)
    try:
        loc = e.Location
        if isinstance(loc, LocationCurve):
            t = _norm(loc.Curve.ComputeDerivatives(0.5, True).BasisX)  # lokale X
            if t:
                up = XYZ.BasisZ
                # Falls Tangente ≈ parallel zu Z, auf Y ausweichen, um Gimbal-lock zu vermeiden
                cross = XYZ(t.Y*up.Z - t.Z*up.Y, t.Z*up.X - t.X*up.Z, t.X*up.Y - t.Y*up.X)
                if _norm(cross) is None or (abs(cross.X)+abs(cross.Y)+abs(cross.Z)) < 1e-6:
                    up = XYZ.BasisY
                    cross = XYZ(t.Y*up.Z - t.Z*up.Y, t.Z*up.X - t.X*up.Z, t.X*up.Y - t.Y*up.X)
                bz = _norm(cross)                                     # lokale Z = t × up
                by = _norm(XYZ(bz.Y*t.Z - bz.Z*t.Y, bz.Z*t.X - bz.X*t.Z, bz.X*t.Y - bz.Y*t.X))  # by = bz × t
                bx = t                                                # lokale X = Tangente
                if bx and by and bz:
                    y,p,r = _euler_zyx_from_bases(bx, by, bz)
                    return y,p,r,"Curve"
    except:
        pass

    # 3) Fallback
    return 0.0, 0.0, 0.0, "Fallback"

def ifc_guid(e):
    # IFC GUID, sonst UniqueId
    try:
        from Autodesk.Revit.DB import ExporterIFCUtils
        g = ExporterIFCUtils.CreateGUID(e.Id)
        if g: return g
    except: pass
    for pname in ("IFC GUID","IfcGUID","IFCGUID","IFCGlobalId"):
        try:
            p = e.LookupParameter(pname)
            if p and p.StorageType == StorageType.String:
                v = p.AsString()
                if v: return v
        except: pass
    try: return e.UniqueId
    except: return str(e.Id.IntegerValue)

# ---------- Run ----------
raw = flatten(IN[0])
db_elems = [to_db(x) for x in raw if x is not None and not isinstance(x, ElementType)]

guids, points, yaws, pitchs, rolls, sources = [], [], [], [], [], []
for e in db_elems:
    guids.append(ifc_guid(e))
    points.append(midpoint(e))
    y,p,r,src = rotation_ypr_with_source(e)
    yaws.append(y); pitchs.append(p); rolls.append(r); sources.append(src)

OUT = [guids, points, yaws, pitchs, rolls, sources]
# ----------------------------------------
categories_5 = Categories("OST_PipeAccessory")
all_elements_of_category_5 = ElementsOfCategory(Category=categories_5)
python_script_5 = Python(IN[0]=all_elements_of_category_5)  # CPython3; same code as python_script_4
python_script_6 = Python(IN[0]=python_script, IN[1]=python_script_2, IN[2]=python_script_3, IN[3]=python_script_4, IN[4]=python_script_5)  # CPython3
# ---------- python_script_6.python (79 lines) ----------
# IN[0]..IN[4]: je Kategorie ein Paket [guids, points, yaw, pitch, roll, (sources optional)]
# OUT: eine Liste von Einträgen: [IFCGuid, Point, [Yaw,Pitch,Roll], Montagenummer, Kategorie]

import clr
clr.AddReference("ProtoGeometry")
from Autodesk.DesignScript.Geometry import Point as DSPt

def is_point(x):
    try: return isinstance(x, DSPt)
    except: return False

def get_pack(inp):
    if not isinstance(inp, list) or len(inp) < 2:
        return [], [], [], [], [], []
    guids  = inp[0] if len(inp) > 0 else []
    points = inp[1] if len(inp) > 1 else []
    yaws   = inp[2] if len(inp) > 2 else []
    pitchs = inp[3] if len(inp) > 3 else []
    rolls  = inp[4] if len(inp) > 4 else []
    srcs   = inp[5] if len(inp) > 5 else []
    n = min(len(guids), len(points),
            len(yaws) if yaws else len(points),
            len(pitchs) if pitchs else len(points),
            len(rolls) if rolls else len(points))
    if not yaws:   yaws   = [0.0]*n
    if not pitchs: pitchs = [0.0]*n
    if not rolls:  rolls  = [0.0]*n
    if not srcs:   srcs   = [""]*n
    return guids[:n], points[:n], yaws[:n], pitchs[:n], rolls[:n], srcs[:n]

# Feste Eingangsreihenfolge
packs = [IN[0] if len(IN)>0 else None,
         IN[1] if len(IN)>1 else None,
         IN[2] if len(IN)>2 else None,
         IN[3] if len(IN)>3 else None,
         IN[4] if len(IN)>4 else None]

# Anzeigename je Eingang (➡️ hier bei Bedarf an dein Projekt anpassen)
cat_label = {
    0: "Allgemeines Modell",
    1: "Sonderausstattung",
    2: "Rohrformteile",
    3: "Rohre",
    4: "Rohrzubehör"
}

# Priorität: Sonderausstattung zuerst, dann 0,2,3,4
cat_priority = {1:0, 0:1, 2:2, 3:3, 4:4}

records = []
for ci, pk in enumerate(packs):
    if pk is None: continue
    guids, pts, yaws, pitchs, rolls, srcs = get_pack(pk)
    label = cat_label.get(ci, "")
    for i in range(len(guids)):
        p = pts[i]
        z = p.Z if is_point(p) and (p.Z is not None) else float('inf')
        records.append({
            "prio": cat_priority.get(ci, 99),
            "z": z,
            "cat": ci,
            "i": i,
            "label": label,
            "guid": guids[i],
            "pt": p,
            "y": float(yaws[i]),
            "p": float(pitchs[i]),
            "r": float(rolls[i])
        })

# Sortierung: Kategorie-Priorität → Z → stabil
records.sort(key=lambda r: (r["prio"], r["z"], r["cat"], r["i"]))

# Montagenummern & Zieldaten: jetzt MIT Kategorie als 5. Feld
out_list = []
for idx, r in enumerate(records, start=1):
    out_list.append([ r["guid"], r["pt"], [r["y"], r["p"], r["r"]], idx, r["label"] ])

OUT = out_list
# ----------------------------------------
string = StringInput("C:\Users\GussenMa\OneDrive - Viega GmbH & Co. KG\Projekte\FutureLab\Aufgaben\Montageplanung\Dynamo\Sequencing.json")
number = DoubleInput(4)
python_script_7 = Python(IN[0]=python_script_6, IN[1]=string, IN[2]=number)  # CPython3
# ---------- python_script_7.python (102 lines) ----------
# IN[0]: [[guid, Point, [yaw,pitch,roll], montage_idx] ...]  (optional 5. Feld: category)
# IN[1]: optional: Ausgabepfad, z.B. r"C:\Temp\montage.json"
# IN[2]: optional: indent (int), Default 2
# IN[3]: optional: categories list (len == len(IN[0])) falls nicht als 5. Feld vorhanden

import clr, json, os

# Revit/Dynamo
clr.AddReference("ProtoGeometry")
from Autodesk.DesignScript.Geometry import Point as DSPt

# Popup
try:
    clr.AddReference("RevitAPIUI")
    from Autodesk.Revit.UI import TaskDialog
    _use_taskdialog = True
except:
    _use_taskdialog = False
try:
    import System
    from System.Windows.Forms import MessageBox
    _use_winforms = True
except:
    _use_winforms = False

def _popup(msg, title="Export"):
    try:
        if _use_taskdialog:
            TaskDialog.Show(title, msg)
            return
    except:
        pass
    try:
        if _use_winforms:
            MessageBox.Show(msg, title)
            return
    except:
        pass
    # Fallback: nichts

def _is_point(p):
    try: return isinstance(p, DSPt)
    except: return False

def _to_float(x, nd=6):
    try: return round(float(x), nd)
    except: return None

rows = IN[0] if isinstance(IN[0], list) else []
out_path = IN[1] if (len(IN) > 1 and isinstance(IN[1], (str,))) else None
indent = IN[2] if (len(IN) > 2 and isinstance(IN[2], int)) else 2
cat_list = IN[3] if (len(IN) > 3 and isinstance(IN[3], list)) else None

items = []
for i, row in enumerate(rows):
    if not isinstance(row, list) or len(row) < 4:
        continue
    guid = row[0]
    pt   = row[1]
    rot  = row[2] if (isinstance(row[2], list) and len(row[2]) >= 3) else [0.0, 0.0, 0.0]
    idx  = row[3]
    # Kategorie: erst 5. Feld, sonst IN[3], sonst ""
    if len(row) >= 5 and isinstance(row[4], (str,)):
        category = row[4]
    elif cat_list and i < len(cat_list):
        category = cat_list[i]
    else:
        category = ""

    x = _to_float(pt.X) if _is_point(pt) else None
    y = _to_float(pt.Y) if _is_point(pt) else None
    z = _to_float(pt.Z) if _is_point(pt) else None

    yaw   = _to_float(rot[0]); pitch = _to_float(rot[1]); roll = _to_float(rot[2])

    items.append({
        "guid": guid if guid is not None else "",
        "category": category,
        "point": {"x": x, "y": y, "z": z},
        "rotation": {"yaw": yaw, "pitch": pitch, "roll": roll},
        "montage_index": int(idx) if isinstance(idx, (int, float)) else None
    })

payload = {"meta": {"count": len(items)}, "items": items}
json_text = json.dumps(payload, ensure_ascii=False, indent=indent, separators=(",", ": "))

written_path = None
if out_path:
    try:
        folder = os.path.dirname(out_path)
        if folder and not os.path.exists(folder):
            os.makedirs(folder)
        # Python 3: explizites UTF-8
        with open(out_path, "w", encoding="utf-8") as f:
            f.write(json_text)
        written_path = out_path
        _popup("Export erfolgreich:\n{}".format(out_path), "Montage-JSON")
    except Exception as ex:
        _popup("Export fehlgeschlagen:\n{}".format(str(ex)), "Montage-JSON")
        # bei Fehler trotzdem Text zurückgeben

OUT = [json_text, written_path]
# ----------------------------------------
